# Dynamo graph GoogleSheetAPITest_v2.dyn (Dynamo 2.1.0.7500)

string = StringInput("estimation")
getGoogleSheetsInGoogleDrive = BIMOne.GoogleAPI.GetGoogleSheetsInGoogleDrive(filter=string)
code_block = CodeBlock(item=getGoogleSheetsInGoogleDrive.fileIds) { item[1]; }
getSheetsInGoogleSheet = BIMOne.GoogleAPI.GetSheetsInGoogleSheet(spreadsheetID=code_block)
string_2 = StringInput("A:AA")
readGoogleSheet = BIMOne.GoogleAPI.ReadGoogleSheet(spreadsheetId=code_block, sheet=getSheetsInGoogleSheet.sheetTitles, range=string_2)  # frozen
string_3 = StringInput("TEST_NEW")
clearValuesInRangeGoogleSheet = BIMOne.GoogleAPI.ClearValuesInRangeGoogleSheet(spreadsheetId=code_block, sheet=string_3, range=string_2)  # frozen
code_block_2 = CodeBlock { []; }
readGoogleSheetMultipleRanges = BIMOne.GoogleAPI.ReadGoogleSheetMultipleRanges(spreadsheetId=code_block, ranges=code_block_2)
code_block_3 = CodeBlock { ["Résumé client", "1 - Préliminaire"]; }
string_4 = StringInput("TEST123")
boolean = BoolSelector(true)
appendDataToGoogleSheetTable = BIMOne.GoogleAPI.AppendDataToGoogleSheetTable(spreadsheetId=code_block, sheet=getSheetsInGoogleSheet.sheetTitles, range=string_2, data=string_4, includeValuesInResponse=boolean)  # frozen
createNewSheetWithinGoogleSheet = BIMOne.GoogleAPI.CreateNewSheetWithinGoogleSheet(spreadsheetID=code_block, newSheetTitle=string_3)  # frozen
createNewGoogleSheet = BIMOne.GoogleAPI.CreateNewGoogleSheet(spreadsheetTitle=string_3, openInBrowser=boolean)  # frozen
writeDataToGoogleSheet = BIMOne.GoogleAPI.WriteDataToGoogleSheet(spreadsheetId=code_block, sheet=string_3, range=string_2, data=string_4, includeValuesInResponse=boolean)  # frozen
